# Grasshopper definition QuaternionToPlane.gh (Grasshopper 0.9.14)

d = Slider(0, range=-1..1)
b = Slider(0.707, range=-1..1)
c = Slider(0, range=-1..1)
a = Slider(-0.707, range=-1..1)
c_script = CSharpScript(a=a, b=b, c=c, d=d)  # -> out, A; inputs a: Double, b: Double, c: Double, d: Double
# ---------- c_script: C# ----------
    Quaternion q = new Quaternion(a, b, c, d);

    if (q.IsValid) {

      Transform t = q.MatrixForm();

      Plane p = Plane.WorldXY;

      p.Transform(t);

      A = p;


    }//end if
# ---------- end c_script ----------
