# Grasshopper definition ToolParsingAndQuaternionTranslation.gh (Grasshopper 0.9.76)
# plug-ins: FuckQuaternion

# ----
# Parsing Tool Definition
panel = Panel("PERS tooldata activeTool := [TRUE, [[0, 533.4, 883.412],[-0.725346750978911, 0.688328365260748, 0.00633000519824939, -0.00600695064025967]],[55.9090909090909, [-108.712, 76.2, 152.4],[1,0,0,0],0,0,0]];")
rep = ReplaceText(Text=panel, Find="PERS tooldata activeTool := [TRUE, ", RecursiveReplace=False)
panel_2 = Panel(rep)
rep_2 = ReplaceText(Text=rep, Find=";", RecursiveReplace=False)
rep_3 = ReplaceText(Text=rep, Find="[", RecursiveReplace=False)
rep_4 = ReplaceText(Text=rep_3, Find="]", RecursiveReplace=False)
rep_5 = ReplaceText(Text=rep_4, Find=";", RecursiveReplace=False)
split = TextSplit(Text=rep_5, Separators=",")
panel_3 = Panel(split)
panel_4 = Panel("""3
4
4
6""")
partition = PartitionList(List=split, Size=panel_4)
viewer = ParamViewer(partition)
branch = TreeBranch(Tree=partition, Path="{0;0;0}", MaintainPaths=True)
panel_5 = Panel(branch)
branch_2 = TreeBranch(Tree=partition, Path="{0;0;1}", MaintainPaths=True)

panel_6 = Panel(branch_2)

# ----
# Location
number_slider = Slider(2, range=0..10)
item = ListItem(List=branch, Index=number_slider, Wrap=True)
item_2 = ListItem(List=branch, Index=Slider(1, range=0..10), Wrap=True)
item_3 = ListItem(List=branch, Index=Slider(0, range=0..1), Wrap=True)
panel_7 = Panel(item)
panel_8 = Panel(item_2)

# ----
# Rotation
number_slider_2 = Slider(3, range=0..10)
item_4 = ListItem(List=branch_2, Index=number_slider_2, Wrap=True)
item_5 = ListItem(List=branch_2, Index=Slider(2, range=0..10), Wrap=True)
item_6 = ListItem(List=branch_2, Index=Slider(1, range=0..10), Wrap=True)
item_7 = ListItem(List=branch_2, Index=Slider(0, range=0..1), Wrap=True)
quaternion_xyzw = CreateQuaternionFromXYZW(X=item_7, Y=item_6, Z=item_5, W=item_4)
matrix_quaternion = CreateMatrixFromQuaternion(Quaternion=quaternion_xyzw)

# ----
# Model Tool Offset and Tool Length
Z = UnitZ(Factor=1)
amp = Amplitude(Vector=Z, Amplitude=item)
Y = UnitY(Factor=1)
pt = Point(<point referenced from the Rhino model>)
move = Move(Geometry=pt, Motion=amp)  # -> Geometry, Transform
amp_2 = Amplitude(Vector=Y, Amplitude=item_2)
pt_2 = Point(move.Geometry)
move_2 = Move(Geometry=pt_2, Motion=amp_2)  # -> Geometry, Transform
pt_3 = Point(move_2.Geometry)
ln = Line(StartPoint=pt_2, EndPoint=pt_3)
ln_2 = Line(StartPoint=pt, EndPoint=pt_2)

quaternion_axis_angle = CreateQuaternionFromAxisAngle(AxisVector=Vector(0, 0, 1), RotationAngle=0)

# ----
# TCP Plane
X = UnitX(Factor=1)
Y_2 = UnitY(Factor=1)
Z_2 = UnitZ(Factor=1)
amp_3 = Amplitude(Vector=X, Amplitude=Slider(100, range=-100..100))
number_slider_3 = Slider(100, range=-100..100)
amp_4 = Amplitude(Vector=Y_2, Amplitude=number_slider_3)
amp_5 = Amplitude(Vector=Z_2, Amplitude=number_slider_3)
move_3 = Move(Geometry=pt_3, Motion=amp_3)  # -> Geometry, Transform
move_4 = Move(Geometry=pt_3, Motion=amp_4)  # -> Geometry, Transform
move_5 = Move(Geometry=pt_3, Motion=amp_5)  # -> Geometry, Transform
pt_z_offset = Point(move_3.Geometry)
pt_y_offset = Point(move_4.Geometry)
pt_x_offset = Point(move_5.Geometry)
tcp = Point(pt_3)
pl_3pt = Plane3Pt(PointA=tcp, PointB=pt_z_offset, PointC=pt_x_offset)

# ----
# Rotate XY Plane
# to
# Quaternion Angles
xy = XYPlane(Origin=Point(0, 0, 0))
transform = Transform(Geometry=xy, Transform=matrix_quaternion)

# ----
# Move XY Plane To TCP
Z_3 = UnitZ(Factor=1)
amp_6 = Amplitude(Vector=Z_3, Amplitude=item)
move_6 = Move(Geometry=transform, Motion=amp_6)  # -> Geometry, Transform
Y_3 = UnitY(Factor=1)
amp_7 = Amplitude(Vector=Y_3, Amplitude=item_2)
move_7 = Move(Geometry=move_6.Geometry, Motion=amp_7)  # -> Geometry, Transform

# ----
# TCP Origin Axis
ln_y_axis = Line(StartPoint=pt_x_offset, EndPoint=tcp)
ln_x_axis = Line(StartPoint=tcp, EndPoint=pt_z_offset)
ln_axis = Line(StartPoint=tcp, EndPoint=pt_y_offset)

list = ValueList({"0", "90", "180", "270", "360"}, selected="90")

side_to_side = Slider(-1, range=-360..360)
up_down = Slider(-3, range=-360..360)

# ----
# Rotate TCP Manually
# In Degrees
rad = Radians(Degrees=up_down)
rad_2 = Radians(Degrees=side_to_side)
updown_rotax_x = RotateAxis(Geometry=pl_3pt, Angle=rad, Axis=ln_x_axis)  # -> Geometry, Transform
side_to_side_rotax_y = RotateAxis(Geometry=pl_3pt, Angle=rad_2, Axis=ln_y_axis)  # -> Geometry, Transform
rad_3 = Radians(Degrees=side_to_side)
rotax = RotateAxis(Geometry=updown_rotax_x.Geometry, Angle=rad_3, Axis=ln_y_axis)  # -> Geometry, Transform

list_2 = ValueList({"0", "90", "180", "270", "360"}, selected="90")

# ----
# Orient Quaternion to TCP Rotation
number_slider_4 = Slider(90, range=0..360)
rad_4 = Radians(Degrees=list)
rotax_2 = RotateAxis(Geometry=move_7.Geometry, Angle=rad_4, Axis=ln_x_axis)  # -> Geometry, Transform
_0 = Slider(0, range=0..360)
rad_5 = Radians(Degrees=list_2)
rotax_3 = RotateAxis(Geometry=rotax_2.Geometry, Angle=rad_5, Axis=ln_axis)  # -> Geometry, Transform
